# Grasshopper definition 200313_BucklingSimulation_SW.gh (Grasshopper 1.0.7)
# plug-ins: Human, Kangaroo2 Components, karambaGH

layercount = Slider(35, range=3..35)
list = ValueList({"No Internal Structure": 0, "With Internal Structure": 1}, selected="With Internal Structure")

objectrad_m = Slider(0.25, range=0..1)
objectht_m = Slider(1, range=0..1.5)
Z = UnitZ(Factor=objectht_m)
cir = Circle(Plane=PlaneXY(0, 0, 0), Radius=objectrad_m)
extr = Extrude(Base=cir, Direction=Z)

# ----
# InternalStructure
number_slider = Slider(0.1, range=0..0.1)
pt = ConstructPoint(XCoordinate=number_slider, YCoordinate=0, ZCoordinate=0)
pt_2 = ConstructPoint(XCoordinate=Slider(1, range=0..10), YCoordinate=0, ZCoordinate=0)
ln = Line(StartPoint=pt, EndPoint=pt_2)
# Meshing
Z_2 = UnitZ(Factor=Slider(0.5, range=0..1))
extr_2 = Extrude(Base=ln, Direction=Z_2)
number_slider_2 = Slider(4, range=0..10)
arrpolar = PolarArray(Geometry=extr_2, Plane=PlaneXY(0, 0, 0), Count=number_slider_2, Angle=6.283185307)  # -> simplify(flatten(Geometry)), Transform

number_slider_3 = Slider(0, range=0..50)
number_slider_4 = Slider(20, range=0..100)

multiplication = Multiplication(A=objectrad_m, B=Slider(100, range=0..100))
expression = Expression(x="ObjectRadius: ", y=multiplication, z="cm", Expression="Format(\"{0}{1} {2}\", x, y, z)")
texttoscreen = RenderTextToScreen(Text=expression, Location="100,220,0", Size=number_slider_4, Color=RGB(0, 0, 0), m_scWithvp=False)

contour = Contour(Shape=extr, Point=Point(0, 0, 0), Direction=Vector(0, 0, 1), Distance=Slider(0.01, range=0..0.01))  # -> flatten(Contours)
series = Series(Start=0, Step=1, Count=layercount)
item = ListItem(List=contour, Index=series, Wrap=False)
clean = CleanTree(RemoveNulls=True, RemoveInvalid=True, RemoveEmpty=False, Tree=item)
len = Length(Curve=clean)  # -> flatten(Length)

shift = ShiftList(List=clean, Shift=1, Wrap=False)  # -> graft(List)
shift_2 = ShiftList(List=clean, Shift=-1, Wrap=False)  # -> graft(List)
merge = Merge(Data1=shift_2, Data2=shift)
loft = Loft(Curves=merge, Options={Adjust=False, Closed=False, LoftEnds=0, LoftSimp=0, LoftType=0, Rebuild=10, Refit=0.01})  # -> flatten(Loft)

number_slider_5 = Slider(1, range=0..1)
number_slider_6 = Slider(100, range=0..1000)
mesh_uv = MeshSurface(Surface=loft, UCount=number_slider_5, VCount=number_slider_6, Overhang=True, Equalize=False)  # -> graft(Mesh)
nv = NakedVertices(Mesh=mesh_uv)  # -> ClothedIndex, NakedIndex, ClothedPts, simplify(NakedPts)
tstat = TreeStatistics(Tree=nv.NakedPts)  # -> Paths, Length, Count
item_2 = ListItem(List=tstat.Paths, Index=-1, Wrap=True)
branch = TreeBranch(Tree=nv.NakedPts, Path=item_2, MaintainPaths=True)
series_2 = Series(Start=-1, Step=-1, Count=number_slider_6)
series_3 = Series(Start=0, Step=1, Count=number_slider_6)
item_3 = ListItem(List=nv.NakedPts, Index=series_3, Wrap=True)
item_4 = ListItem(List=branch, Index=series_2, Wrap=True)  # -> flatten(Item)
tstat_2 = TreeStatistics(Tree=item_3)  # -> Paths, Length, Count
tstat_3 = TreeStatistics(Tree=item_4)  # -> Paths, Length, Count
concat = Concatenate(FragmentA="{", FragmentB=tstat_2.Count, FragmentC="}")
replace = ReplacePaths(Data=item_4, Search=tstat_3.Paths, Replace=concat)
merge_2 = Merge(Data1=item_3, Data2=replace)

# ----
# Meshing+InternalStructure
c_script = CSharpScript(srfs=arrpolar.Geometry, nakedPts=merge_2)  # -> out, A; inputs srfs: list of Surface, nakedPts: tree of Point3d
# ---------- c_script: C# ----------
    List<Point3d> pts = new List<Point3d>();

    for(int i = 0; i < nakedPts.BranchCount;i++)
    {
      foreach(Surface srf in srfs)
      {
        Print(srf.ToString());
        double dist = 1000;
        Point3d tempPt = new Point3d();
        for(int j = 0; j < nakedPts.Branch(i).Count;j++)
        {
          double u, v;
          srf.ClosestPoint(nakedPts.Branch(i)[j], out u, out v);
          Plane plane;
          srf.FrameAt(u, v, out plane);
          double currentDist = plane.Origin.DistanceTo(nakedPts.Branch(i)[j]);
          if(currentDist < dist)
          {
            dist = currentDist;
            tempPt = nakedPts.Branch(i)[j];
          }
        }
        pts.Add(tempPt);
      }
      Print("------");

    }


    A = pts;
# ---------- end c_script ----------
pt_3 = Point(c_script.A)
partition = PartitionList(List=pt_3, Size=number_slider_2)
avr = Average(Input=partition)
ln_2 = Line(StartPoint=avr, EndPoint=partition)
flip = FlipMatrix(Data=ln_2)
shift_3 = ShiftList(List=flip, Shift=-1, Wrap=False)  # -> graft(List)
shift_4 = ShiftList(List=flip, Shift=1, Wrap=False)  # -> graft(List)
merge_3 = Merge(Data1=shift_3, Data2=shift_4)
loft_2 = Loft(Curves=merge_3, Options={Adjust=False, Closed=False, LoftEnds=0, LoftSimp=0, LoftType=0, Rebuild=10, Refit=0.01})  # -> simplify(Loft)
mesh_uv_2 = MeshSurface(Surface=loft_2, UCount=number_slider_5, VCount=expr("x/4", number_slider_6), Overhang=True, Equalize=False)
pshift = ShiftPaths(Data=mesh_uv_2, Offset=-1)
flip_2 = FlipMatrix(Data=pshift)
merge_4 = Merge(Data1=simplify(flip_2), Data2=simplify(mesh_uv))
mjoin = MeshJoin(Meshes=merge_4)
mesh = Mesh(mesh_uv)
# Karamba Assembly
filter = StreamFilter(Gate=list, Stream0=mesh, Stream1=mjoin)

len_2 = Length(Curve=ln_2)
ma = MassAddition(Input=len_2)  # -> flatten(Result), PartialResults
addition = Addition(A=len, B=ma.Result)
filter_2 = StreamFilter(Gate=list, Stream0=len, Stream1=addition)  # -> flatten(Stream)

# ----
# TextToScreen
panel = Panel("Layer: ")
lng = ListLength(List=clean)
expression_2 = Expression(x=panel, y=lng, Expression="Format(\"{0}{1}\", x, y)")
texttoscreen_2 = RenderTextToScreen(Text=expression_2, Location="100,100,0", Size=number_slider_4, Color=RGB(0, 0, 0), m_scWithvp=False)

printspeed_mm_min = Slider(5000, range=0..20000)
convertto_mm = Slider(1000, range=0..100000)
shift_5 = ShiftList(List=filter_2, Shift=1, Wrap=False)
lng_2 = ListLength(List=shift_5)
multiplication_2 = Multiplication(A=shift_5, B=convertto_mm)

# ---- group: aging in min
division = Division(A=multiplication_2, B=printspeed_mm_min)

# ----
python = GhPythonScript(mins=division)  # -> out, aging; inputs mins: list
# ---------- python: Python ----------
__author__ = "WUD"
__version__ = "2019.11.12"

import rhinoscriptsyntax as rs

finalAging= []
for min in mins:
    if len(finalAging) == 0:
        finalAging.append(min)
    else:
        for i in range(len(finalAging)):
            finalAging[i] += min
        finalAging.append(min)
aging = finalAging
# ---------- end python ----------

# ----
# Naming
panel_2 = Panel("Shell_")
python_2 = GhPythonScript(name=panel_2, length=lng_2)  # -> out, graft(myName)
# ---------- python_2: Python ----------
__author__ = "WUD"
__version__ = "2019.10.23"

import rhinoscriptsyntax as rs

finalName=[]
for i in range(length):
    currentName = name+str(i)
    print currentName
    finalName.append(currentName)
    
myName = finalName
# ---------- end python_2 ----------

# ---- group: Young's Module
eval = Evaluate(F="0.00781 + 0.000012*t + testValue", t=python.aging, testValue=number_slider_3)  # -> graft(r)

# ---- group: Yield Strength
eval_2 = Evaluate(F="0.0005984 + 0.000014*t + testValue", t=python.aging, testValue=number_slider_3)  # -> graft(r)

# ---- group: Shear Module
division_2 = Division(A=eval, B="2.6")  # -> graft(Result)

# ----
expression_3 = Expression(x="PrintSpeed: ", y=printspeed_mm_min, z="mm/min", Expression="Format(\"{0}{1} {2}\", x, y, z)")
texttoscreen_3 = RenderTextToScreen(Text=expression_3, Location="100,190,0", Size=number_slider_4, Color=RGB(0, 0, 0), m_scWithvp=False)

alphat = Panel("0.00001")
matprops = MaterialPropertiesKaramba3D(
    FamilyOfMaterial="concrete",
    Name="3DCP",
    ElementIdentifier=python_2.myName,
    YoungsModulus_kN_cm2=eval,
    InPlaneShearModulus_kN_cm2=division_2,
    TransverseShearModulus_kN_cm2=division_2,
    SpecificWeight_kN_m3=Slider(20.2, range=0..100),
    CoefficientOfThermalExpansion_1_C=alphat,
    YieldStrength_kN_cm2=eval_2,
    mode="Isotrop")  # -> graft(Material)
printwidth_cm = Slider(5, range=0..25)
cross_section = CrossSectionKaramba3D(
    FamilyNameOfCrossSection="concrete",
    NameOfCrossSection="3DCP",
    ElementIdentifier=python_2.myName,
    Material=simplify(matprops),
    Height_cm=printwidth_cm,
    mode="Shell - Const")  # -> simplify(CrossSection)
pt_4 = ConstructPoint(XCoordinate=0, YCoordinate=0, ZCoordinate=0)
meshtoshell = MeshToShellKaramba3D(Mesh=simplify(filter), Identifier=simplify(python_2.myName), CrossSection=cross_section, LimitDistance_m=0.005)  # -> flatten(Element), Points, Info
loads = LoadsKaramba3D(Vector=Vector(0, 0, -1), LCase=Slider(0, range=0..1), mode="Gravity")  # -> flatten(Load)

pt_5 = Point(flatten(meshtoshell.Points))
rdpoints = RemoveDuplicatePointsKaramba3D(Point=pt_5, LimitDistance=0.005)  # -> OutPoint, Info, Indexes
pdecon = Deconstruct(Point=rdpoints.OutPoint)  # -> XComponent, YComponent, ZComponent
smaller = SmallerThan(FirstNumber=pdecon.ZComponent, SecondNumber=Slider(0.001, range=0..0.001))  # -> SmallerThan, OrEqualTo
cull = CullPattern(List=rdpoints.OutPoint, CullPattern=smaller.OrEqualTo)  # -> simplify(List)
lng_3 = ListLength(List=cull)
panel_3 = Panel(lng_3)
series_4 = Series(Start=panel_3, Step=1, Count=panel_3)

pt_6 = ConstructPoint(XCoordinate="1E10", YCoordinate="1E10", ZCoordinate="1E10")
pt_7 = ConstructPoint(XCoordinate="1E-3", YCoordinate="1E-3", ZCoordinate="1E-3")
cross_section_2 = CrossSectionKaramba3D(
    FamilyNameOfCrossSection="DefaultCroSec",
    ElementIdentifier="Spring",
    CTranslation_kN_m=pt_6,
    CRotation_kNm_rad=pt_7,
    mode="Spring")

merge_5 = Merge(Data1=cull, Data2=cull)
ln_3 = Line(StartPoint=cull, EndPoint=cull)
linetobeam = LineToBeamKaramba3D(Line=ln_3, Identifier="Spring", Points=merge_5, New=True, Remove=True, LimitDistance_m=0.005)  # -> Element, Points, Info
vec2pt = Vector2Pt(PointA=pt_4, PointB=cull, Unitize=False)  # -> Vector, Length
supp = SupportKaramba(PosInd=series_4, menu=[buttons(on, on, on, on, on, on)])  # -> flatten(Support)
orientate = OrientateElemKaramba3D(Beam=linetobeam.Element, XOrientation=vec2pt.Vector, mode="Beam")
assemble = AssembleModelKaramba3D(
    Point=linetobeam.Points,
    Elem=flatten([meshtoshell.Element, orientate]),
    Support=flatten(supp),
    Load=flatten(loads),
    CrossSection=flatten([cross_section, cross_section_2]),
    Material=flatten(matprops),
    LimitDistance_m=0.005)  # -> Model, Info, Mass_kg, CenterOfGravity

# ----
# FEA
number_slider_7 = Slider(0.0001, range=0..1)
analyzethii = AnalyzeThIIKaramba3D(Model=assemble.Model, RTolerance=number_slider_7, MaxIterations=Slider(100, range=0..100), NoTensionalNII=Toggle(True))  # -> CalculatedModel, MaximumDisplacement_cm, ResultingForceOfGravity_kN, ElasticEnergy_kNm

# ---- group: View Results
# View Result
modelview = ModelViewKaramba3D(Model=analyzethii.CalculatedModel, LoadCaseFactorsForLinearSuperposition=1, IndexOfVisibleLoadcase=-1)  # -> Model, DeformedMesh, DeformedAxes, DeformedModel

# ----
shellview = ShellViewKaramba3D(Model=modelview.Model, IndexOfLayer=0)  # -> Model, MeshesOfRenderedShells, LegendColors, LegendTags
mesh_2 = Mesh(shellview.MeshesOfRenderedShells)
legend = Legend(Colour=shellview.LegendColors, Tags=shellview.LegendTags, LegendType=1)
mjoin_2 = MeshJoin(Meshes=mesh_2)

panel_4 = Panel(shellview.LegendTags)
item_5 = ListItem(List=panel_4, Index="-2", Wrap=True)
item_6 = ListItem(List=panel_4, Index=Slider(1, range=0..1), Wrap=True)
expression_4 = Expression(x="MinStress:  ", y=item_6, z="[kN/cm2]", Expression="Format(\"{0}{1} {2}\", x, y, z)")
expression_5 = Expression(x="MaxStress: ", y=item_5, z="[kN/cm2]", Expression="Format(\"{0}{1} {2}\", x, y, z)")
texttoscreen_4 = RenderTextToScreen(Text=expression_4, Location="100,250,0", Size=number_slider_4, Color=RGB(0, 0, 0), m_scWithvp=False)
texttoscreen_5 = RenderTextToScreen(Text=expression_5, Location="100,280,0", Size=number_slider_4, Color=RGB(0, 0, 0), m_scWithvp=False)

expression_6 = Expression(
    x="MaximumDisplacement: ",
    y=analyzethii.MaximumDisplacement_cm,
    z="cm",
    Expression="Format(\"{0}{1:0.000} {2}\", x, y, z)")
panel_5 = Panel(expression_6)
texttoscreen_6 = RenderTextToScreen(Text=expression_6, Location="100,130,0", Size=number_slider_4, Color=RGB(0, 0, 0), m_scWithvp=False)

expression_7 = Expression(x="PrintWidth: ", y=printwidth_cm, z="cm", Expression="Format(\"{0}{1} {2}\", x, y, z)")
texttoscreen_7 = RenderTextToScreen(Text=expression_7, Location="100,160,0", Size=number_slider_4, Color=RGB(0, 0, 0), m_scWithvp=False)
