# Grasshopper definition 200504_BucklingSimulation_SW.gh (Grasshopper 1.0.7)
# plug-ins: MeshEdit Components, Pufferfish, Human, karambaGH

# ----
# Geometry
objectrad_m = Slider(0.25, range=0..1)
objectht_m = Slider(1, range=0..1.5)
Z = UnitZ(Factor=objectht_m)
cir = Circle(Plane=PlaneXY(0, 0, 0), Radius=objectrad_m)
extr = Extrude(Base=cir, Direction=Z)

layercount = Slider(46, range=3..50)

# ----
# Slicing
number_slider = Slider(0.01, range=0..0.01)
contour = Contour(Shape=extr, Point=Point(0, 0, 0), Direction=Vector(0, 0, 1), Distance=number_slider)  # -> flatten(Contours)
series = Series(Start=0, Step=1, Count=layercount)
item = ListItem(List=contour, Index=series, Wrap=False)
clean = CleanTree(RemoveNulls=True, RemoveInvalid=True, RemoveEmpty=False, Tree=item)
len = Length(Curve=clean)  # -> flatten(Length)

number_slider_2 = Slider(0, range=0..50)

shift = ShiftList(List=clean, Shift=1, Wrap=False)  # -> graft(List)
# Meshing
shift_2 = ShiftList(List=clean, Shift=-1, Wrap=False)  # -> graft(List)
merge = Merge(Data1=shift_2, Data2=shift)
loft = Loft(Curves=merge, Options={Adjust=False, Closed=False, LoftEnds=0, LoftSimp=0, LoftType=0, Rebuild=10, Refit=0.01})  # -> flatten(Loft)
mesh_uv = MeshSurface(Surface=loft, UCount=Slider(1, range=0..1), VCount=Slider(100, range=0..1000), Overhang=True, Equalize=False)  # -> graft(Mesh)

mesh = Mesh(mesh_uv)
number_slider_3 = Slider(20, range=0..100)

# ----
# TextToScreen
panel = Panel("Layer: ")
lng = ListLength(List=clean)
expression = Expression(x=panel, y=lng, Expression="Format(\"{0}{1}\", x, y)")
texttoscreen = RenderTextToScreen(Text=expression, Location="100,100,0", Size=number_slider_3, Color=RGB(0, 0, 0), m_scWithvp=False)

multiplication = Multiplication(A=objectrad_m, B=Slider(100, range=0..100))
expression_2 = Expression(x="ObjectRadius: ", y=multiplication, z="cm", Expression="Format(\"{0}{1} {2}\", x, y, z)")
texttoscreen_2 = RenderTextToScreen(Text=expression_2, Location="100,220,0", Size=number_slider_3, Color=RGB(0, 0, 0), m_scWithvp=False)

number_slider_4 = Slider(1, range=0..10)
number_slider_5 = Slider(0.01, range=0..0.01)
X = UnitX(Factor=Slider(-0.01, range=-1..0.1))

printspeed_mm_min = Slider(5000, range=0..20000)
convertto_mm = Slider(1000, range=0..100000)
# Aging
shift_3 = ShiftList(List=len, Shift=1, Wrap=False)
lng_2 = ListLength(List=shift_3)
multiplication_2 = Multiplication(A=shift_3, B=convertto_mm)

# ---- group: aging in min
division = Division(A=multiplication_2, B=printspeed_mm_min)

# ----
python = GhPythonScript(mins=division)  # -> out, aging; inputs mins: list
# ---------- python: Python ----------
__author__ = "WUD"
__version__ = "2019.11.12"

import rhinoscriptsyntax as rs

finalAging= []
for min in mins:
    if len(finalAging) == 0:
        finalAging.append(min)
    else:
        for i in range(len(finalAging)):
            finalAging[i] += min
        finalAging.append(min)
aging = finalAging
# ---------- end python ----------

# ----
# Naming
# CustomMaterialProperties
panel_2 = Panel("Shell_")
python_2 = GhPythonScript(name=panel_2, length=lng_2)  # -> out, graft(myName)
# ---------- python_2: Python ----------
__author__ = "WUD"
__version__ = "2019.10.23"

import rhinoscriptsyntax as rs

finalName=[]
for i in range(length):
    currentName = name+str(i)
    print currentName
    finalName.append(currentName)
    
myName = finalName
# ---------- end python_2 ----------

# ---- group: Young's Module
eval = Evaluate(F="0.00781 + 0.000012*t + testValue", t=python.aging, testValue=number_slider_2)  # -> graft(r)

# ---- group: Yield Strength
eval_2 = Evaluate(F="0.0005984 + 0.000014*t + testValue", t=python.aging, testValue=number_slider_2)  # -> graft(r)

# ---- group: Shear Module
division_2 = Division(A=eval, B="2.6")  # -> graft(Result)

# ----
expression_3 = Expression(x="PrintSpeed: ", y=printspeed_mm_min, z="mm/min", Expression="Format(\"{0}{1} {2}\", x, y, z)")
texttoscreen_3 = RenderTextToScreen(Text=expression_3, Location="100,190,0", Size=number_slider_3, Color=RGB(0, 0, 0), m_scWithvp=False)

alphat = Panel("0.00001")
matprops = MaterialPropertiesKaramba3D(
    FamilyOfMaterial="concrete",
    Name="3DCP",
    ElementIdentifier=python_2.myName,
    YoungsModulus_kN_cm2=eval,
    InPlaneShearModulus_kN_cm2=division_2,
    TransverseShearModulus_kN_cm2=division_2,
    SpecificWeight_kN_m3=Slider(20.2, range=0..100),
    CoefficientOfThermalExpansion_1_C=alphat,
    YieldStrength_kN_cm2=eval_2,
    mode="Isotrop")  # -> graft(Material)
printwidth_cm = Slider(5, range=0..25)
cross_section = CrossSectionKaramba3D(
    FamilyNameOfCrossSection="concrete",
    NameOfCrossSection="3DCP",
    ElementIdentifier=python_2.myName,
    Material=simplify(matprops),
    Height_cm=printwidth_cm,
    mode="Shell - Const")  # -> simplify(CrossSection)
pt = ConstructPoint(XCoordinate=0, YCoordinate=0, ZCoordinate=0)
meshtoshell = MeshToShellKaramba3D(Mesh=simplify(mesh), Identifier=simplify(python_2.myName), CrossSection=cross_section, LimitDistance_m=0.005)  # -> flatten(Element), Points, Info
loads = LoadsKaramba3D(Vector=Vector(0, 0, -1), LCase=Slider(0, range=0..1), mode="Gravity")  # -> flatten(Load)

# ----
# Karamba Assembly
pt_2 = Point(flatten(meshtoshell.Points))
rdpoints = RemoveDuplicatePointsKaramba3D(Point=pt_2, LimitDistance=0.005)  # -> OutPoint, Info, Indexes
pdecon = Deconstruct(Point=rdpoints.OutPoint)  # -> XComponent, YComponent, ZComponent
smaller = SmallerThan(FirstNumber=pdecon.ZComponent, SecondNumber=Slider(0.001, range=0..0.001))  # -> SmallerThan, OrEqualTo
cull = CullPattern(List=rdpoints.OutPoint, CullPattern=smaller.OrEqualTo)  # -> simplify(List)
lng_3 = ListLength(List=cull)
panel_3 = Panel(lng_3)
series_2 = Series(Start=panel_3, Step=1, Count=panel_3)

pt_3 = ConstructPoint(XCoordinate="1E10", YCoordinate="1E10", ZCoordinate="1E10")
pt_4 = ConstructPoint(XCoordinate="1E-3", YCoordinate="1E-3", ZCoordinate="1E-3")
cross_section_2 = CrossSectionKaramba3D(
    FamilyNameOfCrossSection="DefaultCroSec",
    ElementIdentifier="Spring",
    CTranslation_kN_m=pt_3,
    CRotation_kNm_rad=pt_4,
    mode="Spring")

merge_2 = Merge(Data1=cull, Data2=cull)
ln = Line(StartPoint=cull, EndPoint=cull)
linetobeam = LineToBeamKaramba3D(Line=ln, Identifier="Spring", Points=merge_2, New=True, Remove=True, LimitDistance_m=0.005)  # -> Element, Points, Info
vec2pt = Vector2Pt(PointA=pt, PointB=cull, Unitize=False)  # -> Vector, Length
supp = SupportKaramba(PosInd=series_2, menu=[buttons(on, on, on, on, on, on)])  # -> flatten(Support)
orientate = OrientateElemKaramba3D(Beam=linetobeam.Element, XOrientation=vec2pt.Vector, mode="Beam")
assemble = AssembleModelKaramba3D(
    Point=linetobeam.Points,
    Elem=flatten([meshtoshell.Element, orientate]),
    Support=flatten(supp),
    Load=flatten(loads),
    CrossSection=flatten([cross_section, cross_section_2]),
    Material=flatten(matprops),
    LimitDistance_m=0.005)  # -> Model, Info, Mass_kg, CenterOfGravity

# ----
# FEA
number_slider_6 = Slider(0.0001, range=0..1)
analyzethii = AnalyzeThIIKaramba3D(Model=assemble.Model, RTolerance=number_slider_6, MaxIterations=Slider(100, range=0..100), NoTensionalNII=Toggle(True))  # -> CalculatedModel, MaximumDisplacement_cm, ResultingForceOfGravity_kN, ElasticEnergy_kNm

# ---- group: View Results
# View Result
modelview = ModelViewKaramba3D(Model=analyzethii.CalculatedModel, LoadCaseFactorsForLinearSuperposition=1, IndexOfVisibleLoadcase=-1)  # -> Model, DeformedMesh, DeformedAxes, DeformedModel

# ----
shellview = ShellViewKaramba3D(Model=modelview.Model, IndexOfLayer=0)  # -> Model, MeshesOfRenderedShells, LegendColors, LegendTags
mesh_2 = Mesh(shellview.MeshesOfRenderedShells)
legend = Legend(Colour=shellview.LegendColors, Tags=shellview.LegendTags, LegendType=1)
mjoin = MeshJoin(Meshes=mesh_2)

explode = MeshExplode(Mesh=mesh_2, Interpolate=False)

panel_4 = Panel(shellview.LegendTags)
item_2 = ListItem(List=panel_4, Index="-2", Wrap=True)
item_3 = ListItem(List=panel_4, Index=Slider(1, range=0..1), Wrap=True)
expression_4 = Expression(x="MinStress:  ", y=item_3, z="[kN/cm2]", Expression="Format(\"{0}{1} {2}\", x, y, z)")
expression_5 = Expression(x="MaxStress: ", y=item_2, z="[kN/cm2]", Expression="Format(\"{0}{1} {2}\", x, y, z)")
texttoscreen_4 = RenderTextToScreen(Text=expression_4, Location="100,250,0", Size=number_slider_3, Color=RGB(0, 0, 0), m_scWithvp=False)
texttoscreen_5 = RenderTextToScreen(Text=expression_5, Location="100,280,0", Size=number_slider_3, Color=RGB(0, 0, 0), m_scWithvp=False)

item_4 = ListItem(List=explode, Index=0, Wrap=True)
demesh = DeconstructMesh(Mesh=item_4)  # -> Vertices, Faces, Colours, Normals

expression_6 = Expression(
    x="MaximumDisplacement: ",
    y=analyzethii.MaximumDisplacement_cm,
    z="cm",
    Expression="Format(\"{0}{1:0.000} {2}\", x, y, z)")
panel_5 = Panel(expression_6)
texttoscreen_6 = RenderTextToScreen(Text=expression_6, Location="100,130,0", Size=number_slider_3, Color=RGB(0, 0, 0), m_scWithvp=False)

expression_7 = Expression(x="PrintWidth: ", y=printwidth_cm, z="cm", Expression="Format(\"{0}{1} {2}\", x, y, z)")
texttoscreen_7 = RenderTextToScreen(Text=expression_7, Location="100,160,0", Size=number_slider_3, Color=RGB(0, 0, 0), m_scWithvp=False)

pt_5 = Point(demesh.Vertices)
item_5 = ListItem(List=flatten(pt_5), Index=-2, Wrap=True)
item_6 = ListItem(List=pt_5, Index=Slider(0, range=0..10), Wrap=True)
panel_6 = Panel(pt_5)
merge_3 = Merge(Data1=item_6, Data2=item_5)  # -> flatten(Result)
dispatch = Dispatch(List=merge_3, DispatchPattern=[True, False])  # -> ListA, ListB
brep_cp = BrepClosestPoint(Point=dispatch.ListA, Brep=extr)  # -> Point, Normal, Distance
multiplication_3 = Multiplication(A=brep_cp.Distance, B=Slider(1000, range=0..1000))
pt_6 = Point(dispatch.ListA)
shift_4 = ShiftList(List=pt_6, Shift=1, Wrap=True)
intcrv = Interpolate(Vertices=shift_4, Degree=3, Periodic=False, KnotStyle=1)  # -> Curve, Length, Domain
xz = XZPlane(Origin=pt_6)
roundd = RoundToDecimalPlace(NumberX=multiplication_3, DecimalPlace=Slider(1, range=0..1), RoundType=0)  # -> Rounded, Difference
flippln = FlipPlane(Plane=xz, FlipX=Toggle(True), FlipY=Toggle(False), FlipZ=Toggle(False))  # -> Flipped, R
panel_7 = Panel(pt_6)
concat = Concatenate(FragmentA=roundd.Rounded, FragmentB="[mm]")
move = Move(Geometry=flippln.Flipped, Motion=X)  # -> Geometry, Transform
tag = TextTag3D(
    Location=move.Geometry,
    Text=concat,
    Size=Slider(0.008, range=0..0.01),
    Colour=ColourSwatch(SwatchColor=RGB(20, 20, 20)),
    Justification=7)
